# Grasshopper definition edge support brick.ghx (Grasshopper 1.0.7)
# plug-ins: Human, treesloth01, Noise 4D

crv = Curve(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)
number_slider = Slider(10, range=0..10)
number_slider_2 = Slider(8, range=0..10)
number_slider_3 = Slider(10, range=0..10)
number_slider_4 = Slider(8, range=0..10)
remap = RemapNumbers(Value=Slider(85, range=0..300), Source=Slider(300, range=0..1000), Target=Slider(10, range=0..10))  # -> Mapped, Clipped
dom = ConstructDomain(DomainStart=Slider(5, range=0..10), DomainEnd=Slider(150, range=0..1000))
genes = GenePool(
    Decimals=2,
    Maximum=150,
    Minimum=5,
    Value=[130.5681152, 38.95410797, 150, 22.37884377, 133.9729909, 94.37723951, 53.57723867, 109.6577761])
number_slider_5 = Slider(10, range=0..10)
random = Random(Range=dom, Number=Slider(8, range=0..10), Seed=Slider(10, range=0..10))
divide = DivideCurve(Curve=crv, Count=expr("x-1", number_slider_4), Kinks=False)  # -> Points, Tangents, Parameters
divide_2 = DivideCurve(Curve=crv, Count=expr("x-1", number_slider_4), Kinks=False)  # -> Points, Tangents, Parameters
perlin = PerlinNoise(Values=divide.Points, Time=remap.Mapped, Scale=Slider(100, range=0..100))
dom_2 = ConstructDomain(DomainStart="-1.1", DomainEnd="1")
dom_3 = ConstructDomain(DomainStart=0, DomainEnd="250")
dom_4 = ConstructDomain(DomainStart="-100", DomainEnd="100")
remap_2 = RemapNumbers(Value=perlin, Source=dom_2, Target=dom_3)  # -> Mapped, Clipped
split = SplitList(List=remap_2.Mapped, Index=number_slider_4)  # -> ListA, ListB
bnd = Bounds(Numbers=remap_2.Mapped)
dedomain = DeconstructDomain(Domain=bnd)  # -> Start, End
Z = UnitZ(Factor=split.ListA)
addition = Addition(A=dedomain.End, B="20")
remap_3 = RemapNumbers(Value=perlin, Source=dom_2, Target=dom_4)  # -> Mapped, Clipped
X = UnitX(Factor=remap_3.Mapped)
move = Move(Geometry=divide.Points, Motion=X)  # -> Geometry, Transform
move_2 = Move(Geometry=move.Geometry, Motion=Z)  # -> Geometry, Transform
intcrv = Interpolate(Vertices=move_2.Geometry, Degree=3, Periodic=False, KnotStyle=1)  # -> simplify(Curve), Length, Domain
project = Project(Geometry=intcrv.Curve, Plane=PlaneXY(0, 0, 0))  # -> Geometry, Transform
crv_2 = Curve(project.Geometry)
loft = Loft(
    Curves=[intcrv.Curve, project.Geometry],
    Options={Adjust=False, Closed=False, LoftEnds=0, LoftSimp=0, LoftType=0, Rebuild=10, Refit=0.01})
item = ListItem(List=flatten(crv_2), Index=0, Wrap=True)  # -> Item, Item1, Item2
number_slider_6 = Slider(22, range=15..30)
number_slider_7 = Slider(32, range=0..100)
number_slider_8 = Slider(136, range=1..200)
number_slider_9 = Slider(10, range=0..10)
ext = ExtendCurve(Curve=item.Item, Type=0, Start=number_slider_6, End=number_slider_6)
rad = Radians(Degrees=Slider(45, range=0..360))
end = EndPoints(Curve=crv_2)  # -> Start, End

# ---- group: Generate Bricks
python = GhPythonScript(
    curve=ext,
    attractor=move_2.Geometry,
    wallHeight=addition,
    brickHeight=number_slider_9,
    brickWidth=Slider(15, range=0..100),
    brickLength=number_slider_7,
    tolerance=Slider(7, range=0..10),
    type="2",
    angle=rad,
    farthest=Slider(200, range=0..200))  # -> brick, plane, srf, crv; inputs curve: Curve, attractor: list of Point3d, type: Int32
# ---------- python: Python ----------
import Rhino.Geometry as rg
from ghpythonlib.components import ColourRGB, Pipe
import math
from copy import deepcopy

class Wall:
    def __init__(self, crv, Height, attr):
        #Generate wall
        self.crv = crv
        self.Height = Height
        self.attr = attr

        self.contourCurve(self.crv)
        self.getPts(self.contourCrv)
        self.getPlanes()
        self.rotatePlanes()
        #self.addEndBrick()


    def addEndBrick(self):
        self.crvExtension = []
        self.a = []
        for i, crv in enumerate(self.contourCrv):
            
            lastPt = self.frameList[i][-1].Origin
            param = crv.ClosestPoint(lastPt)[1]
            crv = crv.Split(param)[0]
            self.a.append(crv)
            
            if i%2 == 0:
                crvExtend = crv.Extend(rg.CurveEnd.Start, tolerance/2 + brickWidth/2 + brickWidth + 3, 0) #dont touch
                self.crvExtension.append(crvExtend)
            else:
                self.crvExtension.append(crv)
        
        ptLength = [len(branch) for branch in self.crvPtsBranch]
        if ptLength[0] == ptLength[1]:
            print 1
            for i in range(len(ptLength)):
                if i%2 == 1:
                    self.crvExtension[i] = self.crvExtension[i].Extend(rg.CurveEnd.End, tolerance/2+ brickWidth*1.8, 0)
            for i, crv in enumerate(self.crvExtension):
                if i%2 == 0:
                    firstPlane = deepcopy(self.frameList[i][0])
                    tran1 = rg.Transform.Rotation(0.5*math.pi, firstPlane.Origin)
                    tran2 = rg.Transform.Translation(crv.PointAtStart - firstPlane.Origin)
                    firstPlane.Transform(tran1)
                    firstPlane.Transform(tran2)
                    self.frameList[i].insert(0, firstPlane)
                    
                if i%2 == 1:
                    lastPlane = deepcopy(self.frameList[i][-1])
                    tran1 = rg.Transform.Rotation(0.5*math.pi, lastPlane.Origin)
                    tran2 = rg.Transform.Translation(crv.PointAtEnd - lastPlane.Origin)
                    lastPlane.Transform(tran1)
                    lastPlane.Transform(tran2)
                    self.frameList[i].insert(len(self.frameList[i]), lastPlane)
        
        else:
            print 2
            for i in range(len(ptLength)):
                pass
                if i%2 == 0:
                    self.crvExtension[i] = self.crvExtension[i].Extend(rg.CurveEnd.End, tolerance/2+ brickWidth*1.8, 0)
        
            for i, crv in enumerate(self.crvExtension):
                if i%2 == 0:
                    firstPlane = deepcopy(self.frameList[i][0])
                    tran1 = rg.Transform.Rotation(0.5*math.pi, firstPlane.Origin)
                    tran2 = rg.Transform.Translation(crv.PointAtStart - firstPlane.Origin)
                    firstPlane.Transform(tran1)
                    firstPlane.Transform(tran2)
                    self.frameList[i].insert(0, firstPlane)
                    
                    lastPlane = deepcopy(self.frameList[i][-1])
                    tran1 = rg.Transform.Rotation(0.5*math.pi, lastPlane.Origin)
                    tran2 = rg.Transform.Translation(crv.PointAtEnd - lastPlane.Origin)
                    lastPlane.Transform(tran1)
                    lastPlane.Transform(tran2)
                    self.frameList[i].insert(len(self.frameList[i]), lastPlane)
                    
                    


    def rotatePlanes(self):
        #Find out the direction of brick
        self.vecListBranch = []
        for _crvPts, _ID in zip(self.crvPtsBranch, self.crvIDBranch):
            _vecList = []
            for i in range(len(_crvPts)):
                para = self.contourCrv[_ID[i]].ClosestPoint(_crvPts[i])[1]
                vec = self.contourCrv[_ID[i]].TangentAt(para)
                #vec.Unitize()
                _vecList.append(vec)
            self.vecListBranch.append(_vecList)
        #help(rg.Curve.ClosestPoint)
        
        self.rotateAngleBranch = []
        for crvPts, vecList in zip(self.crvPtsBranch, self.vecListBranch):
            rotateAngle = []
            for i in crvPts:
                minDist = self.attrDist(i)
                if minDist < farthest:
                    rot=1
                    rot *= (farthest - minDist)/(farthest)*angle
                    rotateAngle.append(rot)
                else:
                    rotateAngle.append(0)
            self.rotateAngleBranch.append(rotateAngle)
                
            for i in range(len(vecList)):
                vecList[i].Rotate(rotateAngle[i]*math.pi*2/360, rg.Vector3d(0,0,1))
            
        for i, (angleBranch, planeBranch) in enumerate(zip(self.rotateAngleBranch, self.frameList)):
            for j, (_angle, plane) in enumerate(zip(angleBranch, planeBranch)):
                tran = rg.Transform.Rotation(_angle, plane.Origin)
                plane.Transform(tran)
                self.frameList[i][j] = plane


    def getPlanes(self):
        #Get Plane of each point  
        self.frameList = []
        for _pt in self.crvPtsBranch:
            planeGroup = []
            for pt in _pt:
                #print(pt)
                u = self.surf.ClosestPoint(pt)[1]
                v = self.surf.ClosestPoint(pt)[2]
                tempPlane = self.surf.FrameAt(u, v)[1]
                tran = rg.Transform.Rotation(math.pi/2, tempPlane.YAxis, tempPlane.Origin)
                tempPlane.Transform(tran)
                planeGroup.append(tempPlane)
            self.frameList.append(planeGroup)


    def getPts(self, curve):
        #The position of brick
        self.crvPtsBranch = []
        self.crvIDBranch = []
        for i, crv in enumerate(curve):   
            #even layers, crvs in this layer were shortened
            if i%2 == 0:
                crvTrim = crv.Trim(rg.CurveEnd.Start, brickLength/2+tolerance/2)
                curve[i]=crvTrim

        #divide the crv according to the length of bricks
        for i,crv in enumerate(curve):
            ptsParam = rg.Curve.DivideByLength(crv, brickLength + tolerance, 1)
            ptGroup = []
            IDgroup = []
            for param in ptsParam:
                pt = crv.PointAt(param)
                ptGroup.append(pt)
                IDgroup.append(i)
            self.crvPtsBranch.append(ptGroup)
            self.crvIDBranch.append(IDgroup)


    def contourCurve(self, curve):
        self.surf = rg.Surface.CreateExtrusion(curve, rg.Vector3d(0, 0, self.Height))
        self.surfBrep = rg.Surface.CreateExtrusion(curve, rg.Vector3d(0, 0, self.Height)).ToBrep()
        
        #Generate crv according to the altitude
        layerNum = int(self.Height/brickHeight)
        self.contourCrv = []
        for i in range(layerNum):
            cut = rg.Brep.CreateContourCurves(self.surfBrep, rg.Plane(rg.Point3d(0,0,i*brickHeight), rg.Vector3d(0,0,1)))
            self.contourCrv.extend(cut)


    def attrDist(self, pt):
        minDist = -1
        for attPt in self.attr:
            dist = pt.DistanceTo(attPt)
            if minDist<0 or dist<minDist:
                minDist = dist
        return minDist


    #Use class Rect to stack bricks on the wall
    def stack(self):
        self.brickBranch = []
        self.planeBranch = []
        for branchRotate, branchVec, branchPt in zip(self.rotateAngleBranch, self.vecListBranch, self.crvPtsBranch):
            brickGroup = []
            planeGroup = []
            for m in range(len(branchPt)):
                tran = rg.Transform.Rotation(branchRotate[m], branchPt[m])
                branchVec[m].Transform(tran)
                r = Rect(branchPt[m][0], branchPt[m][1], branchPt[m][2], brickWidth, brickHeight, brickLength, v=branchVec[m], c=(255,255,255,255))
                r.draw()
                brickGroup.append(r.rect)
            self.brickBranch.append(brickGroup)
            self.planeBranch.append(planeGroup)






class Rect:
    """
    infos
    """
    # initialize my object
    def __init__(self, x, y, z, w, d, h, v=(0,0,1), c=(255,255,255,255)):
        self.x = x
        self.y = y
        self.z = z
        self.vector = rg.Vector3d(v[0], v[1], v[2])
        self.center = rg.Point3d(x,y,z)
        self.plane = rg.Plane(self.center, self.vector)
        self.w = w
        self.d = d
        self.h = h
        self.volume = w * d * h
        
        self.rect = None
        self.color = ColourRGB(c[0], c[1], c[2], c[3])


    def draw(self):
        self.rect = rg.Box(self.plane,
                           rg.Interval(-self.w/2,self.w/2),
                           rg.Interval(-self.d/2,self.d/2),
                           rg.Interval(-self.h/2, self.h/2))



a = Wall(curve, wallHeight, attractor)
b = a.contourCrv

#a.color()
a.stack()
brick = a.brickBranch


srf = a.surf
group = a.crvPtsBranch
plane = a.frameList
crv = a.contourCrv
#crv2 = a.crvExtension

#c = a.a
# ---------- end python ----------

# ----
pt = Point(end.Start)
crv_3 = Curve(python.crv)
brep = Brep(loft)
python_2 = GhPythonScript(bricks=python.plane)  # -> out, simplify(a)
# ---------- python_2: Python ----------
a = bricks
# ---------- end python_2 ----------
item_2 = ListItem(List=python_2.a, Index=0, Wrap=True)
lng = ListLength(List=python_2.a)
item_3 = ListItem(List=flatten(brep), Index=0, Wrap=True)  # -> Item, Item1, Item2
plnaxis = PlaneAxis(P=python_2.a, B=35)
shift = ShiftPaths(Data=python_2.a, Offset=-1)

# ---- group: Iteration Bricks / BRICK DIMENSIONS / width
panel = Panel("15")

# ---- group: Iteration Bricks / BRICK DIMENSIONS / height
panel_2 = Panel("10")

# ---- group: Iteration Bricks / BRICK DIMENSIONS / length
panel_3 = Panel("32")

# ----
brep_2 = Brep(item_3.Item)
pull = PullPoint(Point=shift, Geometry=item_3.Item, ClosestOnly=True)  # -> ClosestPoint, Distance

# ---- group: Iteration Bricks
cluster = Cluster(relay=panel_2, X=panel, Y=panel_3, B=python_2.a)
previewmat = CustomPreviewMaterials(Geometry=cluster, DiffuseColor=RGB(255, 255, 255))

# ----
larger = LargerThan(FirstNumber=pull.Distance, SecondNumber=Slider(0.1, range=0.1..50))  # -> LargerThan, OrEqualTo
sift = SiftPattern(List=shift, SiftPattern=larger.LargerThan)  # -> Output0, Output1
unflatten = UnflattenTree(Tree=sift.Output0, Guide=python_2.a)
pln = Plane(python_2.a)
points = PointList(Points=pln, Size=Slider(5, range=0..10))
pln_2 = Plane([sift.Output0, sift.Output1])
python_3 = GhPythonScript(
    iBrickHeight=number_slider_9,
    iBrickLength=number_slider_7,
    iPlanes=unflatten,
    iGrid=pln,
    iDist=Slider(1.68, range=0..10))  # -> out, a, b, c, oBoolList; inputs iPlanes: tree of Plane, iGrid: tree of Plane
# ---------- python_3: Python ----------
import Rhino.Geometry as rg
from copy import deepcopy
import math as m
import ghpythonlib.treehelpers as th

branch = iPlanes.Branches
path = iPlanes.Paths

gridBranch = iGrid.Branches



boolList = [[0 for i in range(len(branch[j]))] for j in range(len(path))]
for i, layer in enumerate(branch):
    for j, plane in enumerate(layer):
        if str(plane) == "None":
            boolList[i][j]=False
        else:
            boolList[i][j]=True

def trans(beforePlane, afterPlane, index1, index2):
    global gridBranch
    global boolList
    vec = afterPlane.Origin - beforePlane.Origin
    gridBranch[index1][index2].Translate(vec)
    gridBranch[index1][index2].Rotate(m.pi*0.5, gridBranch[index1][index2].ZAxis)
    boolList[index1][index2] = True
######################################################################################

b = []
# Check the wall type
if len(branch[0]) == len(branch[1]):
    for i, (layer, nowBools) in enumerate(zip(branch, boolList)):
        # Skip the first layer
        if i == 0:
            continue
        # Store the last layer condition 
        lastBools = boolList[i-1]
        lastPlane = gridBranch[i-1]
        lastBools.append(False)
        add = rg.Plane.WorldXY
        lastPlane.AddRange([add])
        
        for j, brickPlane in enumerate(layer):
            # Skip the empty place
            if nowBools[j] == False:
                continue
            # Judge the even layers
            elif i%2 == 0:
                frontPlane = deepcopy(brickPlane)
                backPlane = deepcopy(brickPlane)
                frontPlane.Translate(frontPlane.YAxis*iBrickLength/4*iDist + rg.Vector3d(0,0,-iBrickHeight))
                backPlane.Translate(-(backPlane.YAxis)*iBrickLength/4*iDist + rg.Vector3d(0,0,-iBrickHeight))
                
                if lastBools[j] == False:
                    b.append(rg.Sphere(frontPlane.Origin, 5))
                    trans(lastPlane[j], frontPlane, i-1, j)  

                    if lastBools[j+1] == False:
                        b.append(rg.Sphere(backPlane.Origin, 5))
                        trans(lastPlane[j+1], backPlane, i-1, j+1)
                        
                elif lastBools[j+1] == False:
                    b.append(rg.Sphere(backPlane.Origin, 5))
                    trans(lastPlane[j+1], backPlane, i-1, j+1)
                    if lastBools[j] == False:
                        b.append(rg.Sphere(frontPlane.Origin, 5))
                        trans(lastPlane[j], frontPlane, i-1, j)
            
            # Judge the odd layers
            elif i%2 == 1:
                frontPlane = deepcopy(brickPlane)
                backPlane = deepcopy(brickPlane)
                frontPlane.Translate(frontPlane.YAxis*iBrickLength/4*iDist + rg.Vector3d(0,0,-iBrickHeight))
                backPlane.Translate(-(backPlane.YAxis)*iBrickLength/4*iDist + rg.Vector3d(0,0,-iBrickHeight))
                
                if lastBools[j] == False: 
                    b.append(rg.Sphere(backPlane.Origin, 5))
                    trans(lastPlane[j], backPlane, i-1, j)
                    if lastBools[j-1] == False:
                        b.append(rg.Sphere(frontPlane.Origin, 5))
                        trans(lastPlane[j-1], frontPlane, i-1, j-1)
                elif lastBools[j-1] == False:
                    b.append(rg.Sphere(frontPlane.Origin, 5))
                    trans(lastPlane[j-1], frontPlane, i-1, j-1)
                    if lastBools[j] == False:
                        b.append(rg.Sphere(backPlane.Origin, 5))
                        trans(lastPlane[j], backPlane, i-1, j)



else:
    for i, (layer, nowBools) in enumerate(zip(branch, boolList)):
        # Skip the first layer
        if i == 0:
            continue
        # Store the last layer condition 
        lastBools = boolList[i-1]
        lastPlane = gridBranch[i-1]
        lastBools.append(False)
        lastPlane.AddRange([lastPlane[len(lastPlane)-1]])
        #print type(lastPlane)

        
        for j, brickPlane in enumerate(layer):
            # Skip the empty place
            if nowBools[j] == False:
                continue
            # Judge the even layers
            elif i%2 == 0:
                frontPlane = deepcopy(brickPlane)
                backPlane = deepcopy(brickPlane)
                frontPlane.Translate(frontPlane.YAxis*iBrickLength/4*iDist + rg.Vector3d(0,0,-iBrickHeight))
                backPlane.Translate(-(backPlane.YAxis)*iBrickLength/4*iDist + rg.Vector3d(0,0,-iBrickHeight))
                
                if lastBools[j] == False:
                    b.append(rg.Sphere(frontPlane.Origin, 5))
                    trans(lastPlane[j], frontPlane, i-1, j)  

                    if lastBools[j+1] == False:
                        b.append(rg.Sphere(backPlane.Origin, 5))
                        trans(lastPlane[j+1], backPlane, i-1, j+1)
                        
                elif lastBools[j+1] == False:
                    b.append(rg.Sphere(backPlane.Origin, 5))
                    trans(lastPlane[j+1], backPlane, i-1, j+1)
                    if lastBools[j] == False:
                        b.append(rg.Sphere(frontPlane.Origin, 5))
                        trans(lastPlane[j], frontPlane, i-1, j)
            
            # Judge the odd layers
            elif i%2 == 1:
                frontPlane = deepcopy(brickPlane)
                backPlane = deepcopy(brickPlane)
                frontPlane.Translate(frontPlane.YAxis*iBrickLength/4*iDist + rg.Vector3d(0,0,-iBrickHeight))
                backPlane.Translate(-(backPlane.YAxis)*iBrickLength/4*iDist + rg.Vector3d(0,0,-iBrickHeight))
                
                if lastBools[j] == False: 
                    b.append(rg.Sphere(backPlane.Origin, 5))
                    trans(lastPlane[j], backPlane, i-1, j)
                    if lastBools[j-1] == False:
                        b.append(rg.Sphere(frontPlane.Origin, 5))
                        trans(lastPlane[j-1], frontPlane, i-1, j-1)
                elif lastBools[j-1] == False:
                    b.append(rg.Sphere(frontPlane.Origin, 5))
                    trans(lastPlane[j-1], frontPlane, i-1, j-1)
                    if lastBools[j] == False:
                        b.append(rg.Sphere(backPlane.Origin, 5))
                        trans(lastPlane[j], backPlane, i-1, j)
    
    
#a= branch[1]
#print len(b)
c = th.list_to_tree(gridBranch)
oBoolList = th.list_to_tree(boolList)
# ---------- end python_3 ----------
sph = Sphere(Base=pln_2, Radius=Slider(4, range=0..10))
sph_2 = Sphere(Base=unflatten, Radius=Slider(4, range=0..10))
preview = CustomPreview(
    Geometry=sph_2,
    Material={diffuse=RGB(221, 160, 221), emission=RGB(66, 48, 66), shine=0.5, specular=RGB(255, 255, 255), transparency=0})  # disabled
brep_3 = Brep(python_3.b)
pln_3 = Plane(python_3.c)
dispatch = Dispatch(List=pln_3, DispatchPattern=python_3.oBoolList)  # -> ListA, ListB
pln_4 = Plane(flatten(unflatten))
pln_5 = Plane(flatten(dispatch.ListA))
cp = ClosestPoint(Point=pln_5, Cloud=pln_4)  # -> ClosestPoint, CPIndex, Distance
dispatch_2 = Dispatch(List=pln_5, DispatchPattern=cp.Distance)  # -> ListA, ListB
pln_6 = Plane(dispatch_2.ListA)

# ---- group: Iteration Bricks / BRICK DIMENSIONS / height
panel_4 = Panel("10")

# ---- group: Iteration Bricks / BRICK DIMENSIONS / length
panel_5 = Panel("32")

# ---- group: Iteration Bricks / BRICK DIMENSIONS / width
panel_6 = Panel("15")

panel_7 = Panel("15")

# ---- group: Iteration Bricks / BRICK DIMENSIONS / height
panel_8 = Panel("10")

# ---- group: Iteration Bricks / BRICK DIMENSIONS / length
panel_9 = Panel("32")

# ---- group: Iteration Bricks
cluster_2 = Cluster(relay=panel_4, X=panel_6, Y=panel_5, B=pln_4)
previewmat_2 = CustomPreviewMaterials(Geometry=cluster_2, DiffuseColor=RGB(255, 255, 255))

cluster_3 = Cluster(relay=panel_8, X=panel_7, Y=panel_9, B=pln_6)
previewmat_3 = CustomPreviewMaterials(Geometry=cluster_3, DiffuseColor=RGB(255, 255, 255))

# ----
edges = BrepEdges(Brep=cluster_2)  # -> Naked, Interior, NonManifold
edges_2 = BrepEdges(Brep=cluster_3)  # -> Naked, Interior, NonManifold
preview_2 = CustomPreview(Geometry=cluster_2, Material=ColourSwatch(SwatchColor=RGB(255, 255, 255)))
preview_3 = CustomPreview(Geometry=cluster_3, Material=ColourSwatch(SwatchColor=RGB(255, 143, 143)))
previewlw = CustomPreviewLineweights(Geometry=edges.Interior, Shader=ColourSwatch(SwatchColor=RGB(0, 0, 0)), Absolute=False)
previewlw_2 = CustomPreviewLineweights(Geometry=edges_2.Interior, Shader=ColourSwatch(SwatchColor=RGB(0, 0, 0)), Absolute=False)

# ==== cluster PlaneAxis: show plane X Y Z axis.
P = ClusterInput()
B = ClusterInput()
deplane = DeconstructPlane(Plane=graft(P))  # -> Origin, XAxis, YAxis, ZAxis
multiplication = Multiplication(A=[deplane.XAxis, deplane.YAxis, deplane.ZAxis], B=B)
vdisex = VectorDisplayEx(
    Point=deplane.Origin,
    Vector=multiplication,
    Colour=[ColourSwatch(SwatchColor=RGB(235, 52, 52)), ColourSwatch(SwatchColor=RGB(90, 207, 48)), ColourSwatch(SwatchColor=RGB(54, 126, 227))],
    Width=2)

# ==== cluster Cluster
relay = ClusterInput()
X = ClusterInput()
Y = ClusterInput()
Z = UnitZ(Factor=expr("x/2", relay))
box = CenterBox(Base=PlaneXY(0, 0, 0), X=expr("x/2", X), Y=expr("x/2", Y), Z=expr("x/2", relay))
move = Move(Geometry=box, Motion=Z)  # -> Geometry, Transform
B = ClusterInput()
orient = Orient(Geometry=move.Geometry, Source=PlaneXY(0, 0, 0), Target=B)  # -> Geometry, Transform
G = ClusterOutput(orient.Geometry)
